# Grasshopper definition TWISTING_HOPS.gh (Grasshopper 1.0.7)

no_of_cross_sections = Slider(4, range=1..15)
height_30_100 = GetNumber(Slider(80, range=30..100), AtLeast=1, AtMost=1, Maximum=100, Minimum=30, TreeAccess=False)
rotation_1_15 = GetNumber(no_of_cross_sections, AtLeast=1, AtMost=1, Maximum=15, Minimum=1, TreeAccess=False)
width_5_40 = GetNumber(Slider(18, range=5..40), AtLeast=1, AtMost=1, Maximum=40, Minimum=5, TreeAccess=False)
construct_point = ConstructPoint(XCoordinate=0, YCoordinate=0, ZCoordinate=0)
line_sdl = LineSDL(Start=construct_point, Direction=Vector(0, 0, 1), Length=height_30_100)
panel = Panel("""0
0
1
1""")

perp_frames = PerpFrames(Curve=line_sdl, Count=rotation_1_15, Align=True)  # -> Frames, Parameters

number = Number(width_5_40)
rectangle = Rectangle(Plane=perp_frames.Frames, XSize=number, YSize=number, Radius=0)  # -> Rectangle, Length
list_length = ListLength(List=rectangle.Rectangle)
series = Series(Start=0, Step=Slider(4, range=1..12), Count=list_length)
multiplication = Multiplication(A=series, B=rotation_1_15, C=Slider(1, range=1..3))
round = Round(Number=multiplication)  # -> Nearest, Floor, Ceiling

# ---- group: Rotation steps
rotate = Rotate(Geometry=rectangle.Rectangle, Angle=degrees(round.Nearest), Plane=perp_frames.Frames)  # -> Geometry, Transform

# ----
seam = Seam(Curve=reparameterize(rotate.Geometry), Seam=".75")
negative = Negative(Value=Slider(10.2, range=0..50))
extend_curve = ExtendCurve(Curve=seam, Type=0, Start=Slider(-5, range=-5..5), End=negative)
loft = Loft(Curves=extend_curve, Options={Adjust=False, Closed=False, LoftEnds=0, LoftSimp=0, LoftType=0, Rebuild=10, Refit=0.01})
deconstruct_brep = DeconstructBrep(Brep=loft)  # -> Faces, Edges, Vertices
surface = Surface(deconstruct_brep.Faces)
divide_domain² = DivideDomain²(Domain=surface, UCount=Slider(27, range=25..60), VCount="1")
isotrim = Isotrim(Surface=graft(surface), Domain=divide_domain²)
flip_matrix = FlipMatrix(Data=isotrim)
dispatch = Dispatch(List=flip_matrix, DispatchPattern=panel)  # -> ListA, ListB

number_slider = Slider(7, range=2..8)
divide_domain²_2 = DivideDomain²(Domain=dispatch.ListA, UCount=Slider(1, range=0..10), VCount=number_slider)
graft_tree = GraftTree(Tree=dispatch.ListA, IncludeEmptyLists=True, IncludeNullItems=True)
isotrim_2 = Isotrim(Surface=graft_tree, Domain=divide_domain²_2)

division = Division(A=number_slider, B="2")

divide_domain²_3 = DivideDomain²(Domain=dispatch.ListB, UCount=Slider(1, range=0..10), VCount=division)
graft_tree_2 = GraftTree(Tree=dispatch.ListB, IncludeEmptyLists=True, IncludeNullItems=True)
isotrim_3 = Isotrim(Surface=graft_tree_2, Domain=divide_domain²_3)

curve = Curve(graft([isotrim_2, isotrim_3]))
explode = Explode(Curve=curve, Recursive=True)  # -> Segments, Vertices

list_item = ListItem(List=explode.Segments, Index="1", Wrap=True)
evaluate_curve = EvaluateCurve(Curve=reparameterize(list_item), Parameter="0.5")  # -> Point, Tangent, Angle
unit_z = UnitZ(Factor=evaluate_curve.Point)
rotate_2 = Rotate(Vector=evaluate_curve.Tangent, Axis=unit_z, Angle="1.5*pi")
end_points = EndPoints(Curve=list_item)  # -> Start, End
move = Move(Geometry=evaluate_curve.Point, Motion=expr("x*3", rotate_2))  # -> Geometry, Transform
merge = Merge(Data1=end_points.Start, Data2=move.Geometry, Data3=end_points.End)
nurbs_curve = NurbsCurve(Vertices=merge, Degree=3, Periodic=False)  # -> Curve, Length, Domain

list_item_2 = ListItem(List=explode.Segments, Index=0, Wrap=True)  # -> Item, Item1, Item2, Item3
explode_2 = Explode(Curve=extend_curve, Recursive=True)  # -> Segments, Vertices
polyline = PolyLine(Vertices=explode_2.Vertices, Closed=True)
edge_surface = EdgeSurface(CurveA=list_item_2.Item, CurveB=nurbs_curve.Curve, CurveC=list_item_2.Item2, CurveD=list_item_2.Item3)
offset_curve = OffsetCurve(Curve=polyline, Distance=Slider(-0.1, range=-1..0), Corners=1)  # -> flatten(Curve)
loft_2 = Loft(Curves=offset_curve, Options={Adjust=False, Closed=False, LoftEnds=0, LoftSimp=0, LoftType=0, Rebuild=10, Refit=0.01})
cap_holes = CapHoles(Brep=loft_2)
context_bake = ContextBake(Geometry=cap_holes)
context_bake_2 = ContextBake(Geometry=edge_surface)
